# Grasshopper definition building generator.gh (Grasshopper 1.0.8)

inset_bay_count_length = Slider(2, range=1..5)
baycounty = Slider(6, range=1..7)
column_width = Slider(1.85, range=1.7..3)
arch_width = Slider(1.82, range=1.5..3)
wall_thickness = Slider(0.5, range=0.3..0.5)
column_height = Slider(1.88, range=1.8..3)
baycountx = Slider(2, range=1..4)
inset_bay_count_width = Slider(1, range=1..3)
footprint = ValueList({"Rectangle", "L-shape": "L", "C-shape": "C", "Courtyard"}, selected="Rectangle")
expression = Expression(x=baycounty, y=column_width, z=arch_width, u=wall_thickness, Expression="x * (y+z)+ 2*u")
expression_2 = Expression(x=baycountx, y=column_width, z=arch_width, u=wall_thickness, Expression="x * (y+z)+ 2*u")
expression_3 = Expression(x=arch_width, y=column_height, Expression="x/2+y+0.5")
expression_4 = Expression(x=inset_bay_count_length, y=column_width, z=arch_width, u=wall_thickness, Expression="x * (y+z)+ u/2")
expression_5 = Expression(x=inset_bay_count_width, y=column_width, z=arch_width, u=wall_thickness, Expression="x * (y+z)+ u/2")

floor1type = ValueList({"arcade", "colonnade", "solid"}, selected="arcade")
floor_thickness = Slider(0.29, range=0.2..0.6)
floor_edge_offset = Slider(0.1, range=0.1..0.25)
rooftype = ValueList({"flat", "gable", "pointed"}, selected="flat")
storey = Slider(1, range=1..3)
floor2type = ValueList({"arcade", "colonnade", "solid"}, selected="solid")

footprint_curve = CSharpScript(
    footprint=footprint,
    length=expression,
    width=expression_2,
    insetLength=expression_4,
    insetWidth=expression_5,
    floorType=floor1type)  # -> out, footprintCurve; inputs footprint: String, length: Double, width: Double, insetLength: Double, insetWidth: Double, wallThickness: Double, floorType: String
# ---------- footprint_curve: C# ----------
// Grasshopper Script Instance
#region Usings
using System;
using System.Linq;
using System.Collections.Generic;
using Rhino;
using Rhino.Geometry;
#endregion

public class Script_Instance : GH_ScriptInstance
{
    private void RunScript(
		string footprint,
		double length,
		double width,
		double insetLength,
		double insetWidth,
		double wallThickness,
		string floorType,
		ref object footprintCurve)
    {
        double tol = Rhino.RhinoDoc.ActiveDoc.ModelAbsoluteTolerance;
        var outer = new Rectangle3d(Plane.WorldXY, width, length).ToNurbsCurve();
        var curves = new List<Curve>();

        if (floorType == "colonnade") 
        {
            footprint = "Rectangle";
        }

        switch (footprint)
        {
            case "L":
            case "C":
                {
                    var notch = new Rectangle3d(Plane.WorldXY, insetWidth, insetLength).ToNurbsCurve();
                    double dx = footprint == "L"
                        ? width - insetWidth
                        : (width - insetWidth) / 2.0;
                    notch.Translate(new Vector3d(dx, length - insetLength, 0));
                    curves.AddRange(Curve.CreateBooleanDifference(outer, notch, tol) 
                                    ?? Enumerable.Empty<Curve>());
                }
                break;

            case "Courtyard":
                {
                    var hole = new Rectangle3d(Plane.WorldXY, insetWidth, insetLength).ToNurbsCurve();
                    hole.Translate(new Vector3d((width - insetWidth) / 2.0,
                                                (length - insetLength) / 2.0,
                                                0));
                    hole.Reverse();
                    var diffs = Curve.CreateBooleanDifference(outer, hole, tol);
                    if (diffs != null && diffs.Length > 0)
                    {
                        curves.Add(diffs[0]);
                        var inner = hole.DuplicateCurve();
                        inner.Reverse();
                        curves.Add(inner);
                    }
                }
                break;

            default:
                curves.Add(outer);
                break;
        }

        if (curves.Count == 1 && footprint != "Courtyard")
            footprintCurve = curves[0];
        else if (curves.Count > 0)
            footprintCurve = curves;
        else
            footprintCurve = null;
    }
}
# ---------- end footprint_curve ----------
floor1subtractadd = CSharpScript(
    colWidth=column_width,
    archWidth=arch_width,
    wallThickness=wall_thickness,
    bayCountX=baycountx,
    bayCountY=baycounty,
    colHeight=column_height,
    floorType=floor1type,
    length=expression,
    width=expression_2)  # -> out, subtractAdd; inputs colWidth: Double, archWidth: Double, wallThickness: Double, bayCountX: Int32, bayCountY: Int32, colHeight: Double, floorType: String
# ---------- floor1subtractadd: C# ----------
#region Usings
using System;
using System.Linq;
using System.Collections.Generic;
using Rhino;
using Rhino.Geometry;
using Grasshopper;
using Grasshopper.Kernel;
using Grasshopper.Kernel.Data;
using Grasshopper.Kernel.Types;
#endregion

public class Script_Instance : GH_ScriptInstance
{
    /// <summary>
    /// Main entry: generates arches, columns, or solid windows based on floorType,
    /// then unions all geometry into subtractAdd.
    /// </summary>
    private void RunScript(
        double colWidth,
        double archWidth,
        double wallThickness,
        int bayCountX,
        int bayCountY,
        double colHeight,
        string floorType,
        object length,    // Y-dimension
        object width,     // X-dimension
        ref object subtractAdd)
    {
        // Convert inputs
        double lengthVal = ToDouble(length);
        double widthVal  = ToDouble(width);
        double tol       = RhinoDoc.ActiveDoc?.ModelAbsoluteTolerance ?? 1e-6;
        var breps        = new List<Brep>();

        // ---- ARCADE: extruded arches along X & Y edges ----
        if (floorType == "arcade")
        {
            double extrudeY = -lengthVal;
            double extrudeX =  widthVal;
            double step     = colWidth + archWidth;
            double offset   = wallThickness + 0.5 * colWidth + 0.5 * archWidth;

            // X-direction arches
            for (int i = 0; i < bayCountX; i++)
            {
                double cx = offset + i * step;
                var bl   = new Point3d(cx - archWidth/2, 0, 0);
                var br   = new Point3d(cx + archWidth/2, 0, 0);
                var tl   = new Point3d(cx - archWidth/2, 0, colHeight);
                var tr   = new Point3d(cx + archWidth/2, 0, colHeight);
                var apex = new Point3d(cx, 0, colHeight + archWidth/2);

                var curves = new[] {
                    new Arc(tl, apex, tr).ToNurbsCurve(),
                    new Line(br, tr).ToNurbsCurve(),
                    new Line(bl, br).ToNurbsCurve(),
                    new Line(tl, bl).ToNurbsCurve()
                };
                var joined = Curve.JoinCurves(curves, tol);
                if (joined?.Length > 0)
                {
                    var prof = joined[0];
                    var extr = Extrusion.Create(prof, extrudeY, true);
                    if (extr != null) breps.Add(extr.ToBrep(true));
                }
            }

            // Y-direction arches
            for (int j = 0; j < bayCountY; j++)
            {
                double cy = offset + j * step;
                var bl   = new Point3d(0, cy - archWidth/2, 0);
                var br   = new Point3d(0, cy + archWidth/2, 0);
                var tl   = new Point3d(0, cy - archWidth/2, colHeight);
                var tr   = new Point3d(0, cy + archWidth/2, colHeight);
                var apex = new Point3d(0, cy, colHeight + archWidth/2);

                var curves = new[] {
                    new Arc(tl, apex, tr).ToNurbsCurve(),
                    new Line(br, tr).ToNurbsCurve(),
                    new Line(bl, br).ToNurbsCurve(),
                    new Line(tl, bl).ToNurbsCurve()
                };
                var joined = Curve.JoinCurves(curves, tol);
                if (joined?.Length > 0)
                {
                    var prof = joined[0];
                    var extr = Extrusion.Create(prof, extrudeX, true);
                    if (extr != null) breps.Add(extr.ToBrep(true));
                }
            }
        }

        // ---- COLONNADE: columns with square+circle tiers, duplicated on opposite wall faces ----
        else if (floorType == "colonnade")
        {
            double radius = wallThickness * 0.5;
            double height = colHeight + archWidth * 0.5 + 0.5;

            // Along X-edge (front/back)
            double xStart = radius;
            double xEnd   = widthVal - radius;
            double segX   = bayCountX > 0 ? (xEnd - xStart) / bayCountX : 0;
            double yPos   = radius;
            for (int i = 0; i <= bayCountX; i++)
            {
                double x = xStart + segX * i;

                // front face
                AddColumnAt(breps, new Point3d(x, yPos, 0), radius, height);
                // back face (copy along Y)
                AddColumnAt(breps,
                    new Point3d(x, yPos + (lengthVal - wallThickness), 0),
                    radius, height);
            }

            // Along Y-edge (left/right)
            double yStart = radius;
            double yEnd   = lengthVal - radius;
            double segY   = bayCountY > 0 ? (yEnd - yStart) / bayCountY : 0;
            double xPos   = radius;
            for (int j = 0; j <= bayCountY; j++)
            {
                double y = yStart + segY * j;

                // left face
                AddColumnAt(breps, new Point3d(xPos, y, 0), radius, height);
                // right face (copy along X)
                AddColumnAt(breps,
                    new Point3d(xPos + (widthVal - wallThickness), y, 0),
                    radius, height);
            }
        }

        // ---- SOLID: random windows punched through solid walls ----
        else if (floorType == "solid")
        {
            bool[] winX = new bool[bayCountX], winY = new bool[bayCountY];
            double[] hX = new double[bayCountX], wX = new double[bayCountX];
            double[] hY = new double[bayCountY], wY = new double[bayCountY];
            var rand = new Random();
            for (int i = 0, j = bayCountX - 1; i <= j; i++, j--)
            {
                bool f = rand.Next(2) == 1;
                winX[i] = winX[j] = f;
                hX[i] = hX[j] = 0.5 + rand.NextDouble() * (colHeight - 1);
                wX[i] = wX[j] = 0.5 + (archWidth + colWidth) / 4 * rand.NextDouble();
            }
            for (int i = 0, j = bayCountY - 1; i <= j; i++, j--)
            {
                bool f = rand.Next(2) == 1;
                winY[i] = winY[j] = f;
                hY[i] = hY[j] = 0.5 + rand.NextDouble() * (colHeight - 1);
                wY[i] = wY[j] = 0.5 + (archWidth + colWidth) / 4 * rand.NextDouble();
            }

            double off = wallThickness + 0.5 * (colWidth + archWidth);

            // X-facing windows
            for (int i = 0; i < bayCountX; i++)
            {
                if (!winX[i]) continue;
                double t = bayCountX > 1 ? i / (double)(bayCountX - 1) : 0;
                var ctr = new Point3d(off + t * (widthVal - 2 * off), 0, 0.85);
                var pts = new[] {
                    ctr - Vector3d.XAxis * (wX[i]/2),
                    ctr + Vector3d.XAxis * (wX[i]/2),
                    ctr + Vector3d.XAxis * (wX[i]/2) + Vector3d.ZAxis * hX[i],
                    ctr - Vector3d.XAxis * (wX[i]/2) + Vector3d.ZAxis * hX[i]
                };
                var curves = new[] {
                    new Line(pts[0], pts[1]).ToNurbsCurve(),
                    new Line(pts[1], pts[2]).ToNurbsCurve(),
                    new Line(pts[2], pts[3]).ToNurbsCurve(),
                    new Line(pts[3], pts[0]).ToNurbsCurve()
                };
                var joined = Curve.JoinCurves(curves, tol);
                if (joined?.Length > 0)
                {
                    var prof = joined[0];
                    var extr = Extrusion.Create(prof, -lengthVal, true);
                    if (extr != null) breps.Add(extr.ToBrep(true));
                }
            }

            // Y-facing windows
            for (int j = 0; j < bayCountY; j++)
            {
                if (!winY[j]) continue;
                double t = bayCountY > 1 ? j / (double)(bayCountY - 1) : 0;
                var ctr = new Point3d(0, off + t * (lengthVal - 2 * off), 0.85);
                var pts = new[] {
                    ctr - Vector3d.YAxis * (wY[j]/2),
                    ctr + Vector3d.YAxis * (wY[j]/2),
                    ctr + Vector3d.YAxis * (wY[j]/2) + Vector3d.ZAxis * hY[j],
                    ctr - Vector3d.YAxis * (wY[j]/2) + Vector3d.ZAxis * hY[j]
                };
                var curves = new[] {
                    new Line(pts[0], pts[1]).ToNurbsCurve(),
                    new Line(pts[1], pts[2]).ToNurbsCurve(),
                    new Line(pts[2], pts[3]).ToNurbsCurve(),
                    new Line(pts[3], pts[0]).ToNurbsCurve()
                };
                var joined = Curve.JoinCurves(curves, tol);
                if (joined?.Length > 0)
                {
                    var prof = joined[0];
                    var extr = Extrusion.Create(prof, widthVal, true);
                    if (extr != null) breps.Add(extr.ToBrep(true));
                }
            }
        }

        // ---- FINAL UNION ----
        try
        {
            subtractAdd = Brep.CreateBooleanUnion(breps, tol);
        }
        catch
        {
            subtractAdd = breps.ToArray();
        }
    }

    /// <summary>
    /// Builds one column at basePt with:
    /// top-down: square cap (0.025H), circular cap (0.025H),
    /// shaft (0.90H), circular base (0.025H), square base (0.025H).
    /// </summary>
    private void AddColumnAt(
        List<Brep> breps,
        Point3d basePt,
        double r,
        double height)
    {
        double sqBaseH   = 0.025 * height;
        double circBaseH = 0.025 * height;
        double shaftH    = 0.90  * height;
        double circCapH  = 0.025 * height;
        double sqCapH    = 0.025 * height;

        // --- Square extrusion cap (top) ---
        var capSqPlane = new Plane(
            basePt + Vector3d.ZAxis * (sqBaseH + circBaseH + shaftH + circCapH),
            Vector3d.ZAxis
        );
        var capSqBox = new Box(
            capSqPlane,
            new Interval(-r, r),
            new Interval(-r, r),
            new Interval(0, sqCapH)
        );
        breps.Add(Brep.CreateFromBox(capSqBox));

        // --- Circular extrusion cap ---
        breps.Add(
            new Cylinder(
                new Circle(
                    new Plane(
                        basePt + Vector3d.ZAxis * (sqBaseH + circBaseH + shaftH),
                        Vector3d.ZAxis
                    ),
                    r
                ),
                circCapH
            ).ToBrep(true, true)
        );

        // --- Shaft ---
        breps.Add(
            new Cylinder(
                new Circle(
                    new Plane(
                        basePt + Vector3d.ZAxis * (sqBaseH + circBaseH),
                        Vector3d.ZAxis
                    ),
                    r * 0.8
                ),
                shaftH
            ).ToBrep(true, true)
        );

        // --- Circular extrusion base ---
        breps.Add(
            new Cylinder(
                new Circle(
                    new Plane(
                        basePt + Vector3d.ZAxis * sqBaseH,
                        Vector3d.ZAxis
                    ),
                    r
                ),
                circBaseH
            ).ToBrep(true, true)
        );

        // --- Square extrusion base (bottom) ---
        var baseSqPlane = new Plane(basePt, Vector3d.ZAxis);
        var baseSqBox   = new Box(
            baseSqPlane,
            new Interval(-r, r),
            new Interval(-r, r),
            new Interval(0, sqBaseH)
        );
        breps.Add(Brep.CreateFromBox(baseSqBox));
    }

    /// <summary>
    /// Helper: convert int or double input to double.
    /// </summary>
    private double ToDouble(object o)
    {
        if (o is double d) return d;
        if (o is int i)    return i;
        return Convert.ToDouble(o);
    }
}
# ---------- end floor1subtractadd ----------
floor1envelope = CSharpScript(
    footprintCurve=footprint_curve.footprintCurve,
    wallThickness=wall_thickness,
    floorHeight=expression_3,
    floorType=floor1type)  # -> out, floorEnvelope; inputs wallThickness: Double, floorHeight: Double, floorType: String
# ---------- floor1envelope: C# ----------
// Grasshopper Script Instance
#region Usings
using System;
using Rhino;
using Rhino.Geometry;
#endregion

public class Script_Instance : GH_ScriptInstance
{
    private void RunScript(
		object footprintCurve,
		double wallThickness,
		double floorHeight,
		string floorType,
		ref object floorEnvelope)
    {
        floorEnvelope = null;
        if (floorType == "colonnade") return;

        var outer = footprintCurve as Curve;
        if (outer == null) return;

        // close polyline if needed
        if (!outer.IsClosed && outer.TryGetPolyline(out var pl))
        {
            if (!pl.IsClosed) pl.Add(pl[0]);
            outer = new PolylineCurve(pl);
        }

        double tol = RhinoDocument.ModelAbsoluteTolerance;
        var inners = outer.Offset(Plane.WorldXY, -wallThickness, tol, CurveOffsetCornerStyle.Sharp);
        if (inners == null || inners.Length == 0) return;

        var inner = inners[0];
        if (!inner.IsClosed && inner.TryGetPolyline(out var pl2))
        {
            if (!pl2.IsClosed) pl2.Add(pl2[0]);
            inner = new PolylineCurve(pl2);
        }

        var breps = Brep.CreatePlanarBreps(new[] { outer, inner }, tol);
        if (breps == null || breps.Length == 0) return;

        var region = breps[0];
        var c     = region.GetBoundingBox(true).Center;
        var spine = new LineCurve(c, c + Vector3d.ZAxis * floorHeight);

        floorEnvelope = region.Faces[0].CreateExtrusion(spine, true);
    }
}
# ---------- end floor1envelope ----------
correctorientation = CSharpScript(extrudedShape=floor1envelope.floorEnvelope)  # -> out, correctedShape
# ---------- correctorientation: C# ----------
// Grasshopper Script Instance
#region Usings
using System;
using System.Collections.Generic;
using Rhino;
using Rhino.Geometry;
#endregion

public class Script_Instance : GH_ScriptInstance
{
    private void RunScript(object extrudedShape, ref object correctedShape)
    {
        // 1. Cast input to a Brep
        var brep = extrudedShape as Brep;
        if (brep == null)
        {
            correctedShape = null;
            return;
        }

        // 2. Duplicate for modification
        var fixedBrep = brep.DuplicateBrep();
        bool needsFlip = false;
        double tol = RhinoDocument.ModelAbsoluteTolerance;

        // 3. Check each face: if any normal points inside, mark for flip
        foreach (var face in fixedBrep.Faces)
        {
            var amp = AreaMassProperties.Compute(face);
            if (amp == null) continue;

            var center = amp.Centroid;
            var normal = face.NormalAt(face.Domain(0).Mid, face.Domain(1).Mid);
            normal.Unitize();

            var testPoint = center + normal * 0.1;
            if (fixedBrep.IsPointInside(testPoint, tol, false))
            {
                needsFlip = true;
                break;
            }
        }

        // 4. Flip whole Brep if needed
        if (needsFlip)
            fixedBrep.Flip();

        // 5. Output corrected Brep
        correctedShape = fixedBrep;
    }
}
# ---------- end correctorientation ----------
ceiling1generation = CSharpScript(
    footprintCurve=footprint_curve.footprintCurve,
    floorHeight=expression_3,
    floorThickness=floor_thickness,
    edgeOffset=floor_edge_offset,
    footprint=footprint,
    wallThickness=wall_thickness)  # -> out, ceiling; inputs footprintCurve: list, floorHeight: Double, floorThickness: Double, edgeOffset: Double, footprint: String, wallThickness: Double
# ---------- ceiling1generation: C# ----------
// Grasshopper Script Instance
#region Usings
using System;
using System.Collections.Generic;
using System.Linq;
using Rhino;
using Rhino.Geometry;
using Grasshopper.Kernel;
#endregion

public class Script_Instance : GH_ScriptInstance
{
    private void RunScript(
		List<object> footprintCurve,
		double floorHeight,
		double floorThickness,
		double edgeOffset,
		string footprint,
		double wallThickness,
		ref object ceiling)
    {
        if (footprintCurve == null || footprintCurve.Count == 0)
        {
            ceiling = null;
            return;
        }

        // common translation and tolerance
        var move = Transform.Translation(0, 0, floorHeight);
        double tol = RhinoDoc.ActiveDoc.ModelAbsoluteTolerance;

        // extract a sample curve to get a plane
        Curve sample = footprintCurve.OfType<Curve>().FirstOrDefault();
        Plane pl;
        if (sample == null || !sample.TryGetPlane(out pl))
            pl = Plane.WorldXY;

        if (footprint == "Courtyard")
        {
            var bases = footprintCurve.OfType<Curve>().Take(2).ToArray();
            if (bases.Length < 2) { ceiling = null; return; }

            // move, offset (out/in), extrude, boolean diff
            Curve c1 = bases[0].DuplicateCurve(); c1.Transform(move);
            Curve c2 = bases[1].DuplicateCurve(); c2.Transform(move);

            Curve o1 = c1.Offset(pl,  edgeOffset,  tol, CurveOffsetCornerStyle.Sharp)?.FirstOrDefault();
            Curve o2 = c2.Offset(pl, -edgeOffset-wallThickness,  tol, CurveOffsetCornerStyle.Sharp)?.FirstOrDefault();
            if (o1 == null || o2 == null) { ceiling = null; return; }

            Brep b1 = Extrusion.Create(o1, floorThickness, true).ToBrep(true);
            Brep b2 = Extrusion.Create(o2, floorThickness, true).ToBrep(true);

            var diff = Brep.CreateBooleanDifference(new[]{b1}, new[]{b2}, tol);
            ceiling = (diff != null && diff.Length > 0) ? diff[0] : null;
        }
        else
        {
            // non-courtyard: move→offset outward→extrude each curve
            var breps = new List<Brep>();
            foreach (var crv in footprintCurve.OfType<Curve>())
            {
                Curve c = crv.DuplicateCurve(); 
                c.Transform(move);

                Curve off = c.Offset(pl, edgeOffset, tol, CurveOffsetCornerStyle.Sharp)?.FirstOrDefault();
                if (off == null) continue;

                var ex = Extrusion.Create(off, floorThickness, true);
                if (ex != null) breps.Add(ex.ToBrep(true));
            }

            ceiling = breps.Count > 0 ? breps : null;
        }
    }
}
# ---------- end ceiling1generation ----------
floor1generation = CSharpScript(floorEnvelope=correctorientation.correctedShape, subtractAdd=floor1subtractadd.subtractAdd, floorType=floor1type)  # -> out, floorWall
# ---------- floor1generation: C# ----------
#region Usings
using System;
using System.Collections;
using System.Collections.Generic;
using Rhino;
using Rhino.Geometry;
using Grasshopper.Kernel.Data;
using Grasshopper.Kernel.Types;
#endregion

public class Script_Instance : GH_ScriptInstance
{
    private void RunScript(
		object floorEnvelope,
		object subtractAdd,
		object floorType,
		ref object floorWall)
    {
        var envelopes = ExtractBreps(floorEnvelope);
        var subs      = ExtractBreps(subtractAdd);
        double tol   = RhinoDoc.ActiveDoc?.ModelAbsoluteTolerance ?? RhinoMath.UnsetValue;

        Brep[] unionSubs;
        try { unionSubs = Brep.CreateBooleanUnion(subs.ToArray(), tol); }
        catch { unionSubs = subs.ToArray(); }

        string type = (floorType as string)?.ToLowerInvariant();
        var result = new List<Brep>();

        if (type == "colonnade")
        {
            result.AddRange(unionSubs);
        }
        
        else
        {
            var toSubtract = subs.Count > 0 ? subs[0] : null;
            foreach (var env in envelopes)
            {
                if (toSubtract != null)
                {
                    try
                    {
                        var diffs = Brep.CreateBooleanDifference(new[]{ env }, new[]{ toSubtract }, tol);
                        if (diffs?.Length > 0) { result.Add(diffs[0]); continue; }
                    }
                    catch {}
                }
                result.Add(env);
            }
        }

        var tree = new GH_Structure<IGH_Goo>();
        var path = new GH_Path(0);
        foreach (var brep in result)
            tree.Append(new GH_Brep(brep), path);

        floorWall = tree;
    }

    private List<Brep> ExtractBreps(object input)
    {
        var list = new List<Brep>();
        switch (input)
        {
            case Brep b:
                list.Add(b);
                break;
            case Brep[] ba:
                list.AddRange(ba);
                break;
            case IEnumerable ie:
                foreach (var item in ie)
                    if (item is Brep br)
                        list.Add(br);
                break;
        }
        return list;
    }
}
# ---------- end floor1generation ----------

floor2envelope = CSharpScript(
    footprintCurve=footprint_curve.footprintCurve,
    wallThickness=wall_thickness,
    floorHeight=expression_3,
    floorType=floor1type,
    floorThickness=floor_thickness)  # -> out, floorEnvelope; inputs wallThickness: Double, floorHeight: Double, floorType: String, floorThickness: Double
# ---------- floor2envelope: C# ----------
// Grasshopper Script Instance
#region Usings
using System;
using Rhino;
using Rhino.Geometry;
#endregion

public class Script_Instance : GH_ScriptInstance
{
    private void RunScript(
		object footprintCurve,
		double wallThickness,
		double floorHeight,
		string floorType,
		double floorThickness,
		ref object floorEnvelope)
    {
        floorEnvelope = null;
        if (floorType == "colonnade") return;

        var outer = footprintCurve as Curve;
        if (outer == null) return;

        // close polyline if needed
        if (!outer.IsClosed && outer.TryGetPolyline(out var pl))
        {
            if (!pl.IsClosed) pl.Add(pl[0]);
            outer = new PolylineCurve(pl);
        }

        double tol = RhinoDocument.ModelAbsoluteTolerance;
        var inners = outer.Offset(Plane.WorldXY, -wallThickness, tol, CurveOffsetCornerStyle.Sharp);
        if (inners == null || inners.Length == 0) return;

        var inner = inners[0];
        if (!inner.IsClosed && inner.TryGetPolyline(out var pl2))
        {
            if (!pl2.IsClosed) pl2.Add(pl2[0]);
            inner = new PolylineCurve(pl2);
        }

        var breps = Brep.CreatePlanarBreps(new[] { outer, inner }, tol);
        if (breps == null || breps.Length == 0) return;

        var region = breps[0];
        var c      = region.GetBoundingBox(true).Center;
        var spine  = new LineCurve(c, c + Vector3d.ZAxis * floorHeight);

        // create the extrusion
        var extrusion = region.Faces[0].CreateExtrusion(spine, true);

        // translate up by floorHeight + floorThickness
        var translation = Transform.Translation(0, 0, floorHeight + floorThickness);
        extrusion.Transform(translation);

        floorEnvelope = extrusion;
    }
}
# ---------- end floor2envelope ----------
floor2subtractadd = CSharpScript(
    colWidth=column_width,
    archWidth=arch_width,
    wallThickness=wall_thickness,
    bayCountX=baycountx,
    bayCountY=baycounty,
    colHeight=column_height,
    floorType=floor2type,
    length=expression,
    width=expression_2,
    floorHeight=expression_3,
    floorThickness=floor_thickness)  # -> out, subtractAdd; inputs colWidth: Double, archWidth: Double, wallThickness: Double, bayCountX: Int32, bayCountY: Int32, colHeight: Double, floorType: String, floorHeight: Double, floorThickness: Double
# ---------- floor2subtractadd: C# ----------
#region Usings
using System;
using System.Linq;
using System.Collections.Generic;
using Rhino;
using Rhino.Geometry;
using Grasshopper;
using Grasshopper.Kernel;
using Grasshopper.Kernel.Data;
using Grasshopper.Kernel.Types;
#endregion

public class Script_Instance : GH_ScriptInstance
{
    /// <summary>
    /// Main entry: generates arches, columns, or solid windows based on floorType,
    /// then unions all geometry into subtractAdd, and lifts it by floorHeight + floorThickness.
    /// </summary>
    private void RunScript(
		double colWidth,
		double archWidth,
		double wallThickness,
		int bayCountX,
		int bayCountY,
		double colHeight,
		string floorType,
		object length,
		object width,
		double floorHeight,
		double floorThickness,
		ref object subtractAdd)
    {
        // Convert inputs
        double lengthVal = ToDouble(length);
        double widthVal  = ToDouble(width);
        double tol       = RhinoDoc.ActiveDoc?.ModelAbsoluteTolerance ?? 1e-6;
        var breps        = new List<Brep>();

        // ---- ARCADE: extruded arches along X & Y edges ----
        if (floorType == "arcade")
        {
            double extrudeY = -lengthVal;
            double extrudeX =  widthVal;
            double step     = colWidth + archWidth;
            double offset   = wallThickness + 0.5 * colWidth + 0.5 * archWidth;

            // X-direction arches
            for (int i = 0; i < bayCountX; i++)
            {
                double cx = offset + i * step;
                var bl   = new Point3d(cx - archWidth/2, 0, 0);
                var br   = new Point3d(cx + archWidth/2, 0, 0);
                var tl   = new Point3d(cx - archWidth/2, 0, colHeight);
                var tr   = new Point3d(cx + archWidth/2, 0, colHeight);
                var apex = new Point3d(cx, 0, colHeight + archWidth/2);

                var curves = new[] {
                    new Arc(tl, apex, tr).ToNurbsCurve(),
                    new Line(br, tr).ToNurbsCurve(),
                    new Line(bl, br).ToNurbsCurve(),
                    new Line(tl, bl).ToNurbsCurve()
                };
                var joined = Curve.JoinCurves(curves, tol);
                if (joined?.Length > 0)
                {
                    var prof = joined[0];
                    var extr = Extrusion.Create(prof, extrudeY, true);
                    if (extr != null) breps.Add(extr.ToBrep(true));
                }
            }

            // Y-direction arches
            for (int j = 0; j < bayCountY; j++)
            {
                double cy = offset + j * step;
                var bl   = new Point3d(0, cy - archWidth/2, 0);
                var br   = new Point3d(0, cy + archWidth/2, 0);
                var tl   = new Point3d(0, cy - archWidth/2, colHeight);
                var tr   = new Point3d(0, cy + archWidth/2, colHeight);
                var apex = new Point3d(0, cy, colHeight + archWidth/2);

                var curves = new[] {
                    new Arc(tl, apex, tr).ToNurbsCurve(),
                    new Line(br, tr).ToNurbsCurve(),
                    new Line(bl, br).ToNurbsCurve(),
                    new Line(tl, bl).ToNurbsCurve()
                };
                var joined = Curve.JoinCurves(curves, tol);
                if (joined?.Length > 0)
                {
                    var prof = joined[0];
                    var extr = Extrusion.Create(prof, extrudeX, true);
                    if (extr != null) breps.Add(extr.ToBrep(true));
                }
            }
        }

        // ---- COLONNADE: columns with square+circle tiers, duplicated on opposite wall faces ----
        else if (floorType == "colonnade")
        {
            double radius = wallThickness * 0.5;
            double height = colHeight + archWidth * 0.5 + 0.5;

            // Along X-edge (front/back)
            double xStart = radius;
            double xEnd   = widthVal - radius;
            double segX   = bayCountX > 0 ? (xEnd - xStart) / bayCountX : 0;
            double yPos   = radius;
            for (int i = 0; i <= bayCountX; i++)
            {
                double x = xStart + segX * i;
                AddColumnAt(breps, new Point3d(x, yPos, 0), radius, height);
                AddColumnAt(breps, new Point3d(x, yPos + (lengthVal - wallThickness), 0), radius, height);
            }

            // Along Y-edge (left/right)
            double yStart = radius;
            double yEnd   = lengthVal - radius;
            double segY   = bayCountY > 0 ? (yEnd - yStart) / bayCountY : 0;
            double xPos   = radius;
            for (int j = 0; j <= bayCountY; j++)
            {
                double y = yStart + segY * j;
                AddColumnAt(breps, new Point3d(xPos, y, 0), radius, height);
                AddColumnAt(breps, new Point3d(xPos + (widthVal - wallThickness), y, 0), radius, height);
            }
        }

        // ---- SOLID: random windows punched through solid walls ----
        else if (floorType == "solid")
        {
            bool[] winX = new bool[bayCountX], winY = new bool[bayCountY];
            double[] hX = new double[bayCountX], wX = new double[bayCountX];
            double[] hY = new double[bayCountY], wY = new double[bayCountY];
            var rand = new Random();
            for (int i = 0, j = bayCountX - 1; i <= j; i++, j--)
            {
                bool f = rand.Next(2) == 1;
                winX[i] = winX[j] = f;
                hX[i] = hX[j] = 0.5 + rand.NextDouble() * (colHeight - 1);
                wX[i] = wX[j] = 0.5 + (archWidth + colWidth) / 4 * rand.NextDouble();
            }
            for (int i = 0, j = bayCountY - 1; i <= j; i++, j--)
            {
                bool f = rand.Next(2) == 1;
                winY[i] = winY[j] = f;
                hY[i] = hY[j] = 0.5 + rand.NextDouble() * (colHeight - 1);
                wY[i] = wY[j] = 0.5 + (archWidth + colWidth) / 4 * rand.NextDouble();
            }

            double off = wallThickness + 0.5 * (colWidth + archWidth);

            // X-facing windows
            for (int i = 0; i < bayCountX; i++)
            {
                if (!winX[i]) continue;
                double t = bayCountX > 1 ? i / (double)(bayCountX - 1) : 0;
                var ctr = new Point3d(off + t * (widthVal - 2 * off), 0, 0.85);
                var pts = new[] {
                    ctr - Vector3d.XAxis * (wX[i]/2),
                    ctr + Vector3d.XAxis * (wX[i]/2),
                    ctr + Vector3d.XAxis * (wX[i]/2) + Vector3d.ZAxis * hX[i],
                    ctr - Vector3d.XAxis * (wX[i]/2) + Vector3d.ZAxis * hX[i]
                };
                var curves = new[] {
                    new Line(pts[0], pts[1]).ToNurbsCurve(),
                    new Line(pts[1], pts[2]).ToNurbsCurve(),
                    new Line(pts[2], pts[3]).ToNurbsCurve(),
                    new Line(pts[3], pts[0]).ToNurbsCurve()
                };
                var joined = Curve.JoinCurves(curves, tol);
                if (joined?.Length > 0)
                {
                    var prof = joined[0];
                    var extr = Extrusion.Create(prof, -lengthVal, true);
                    if (extr != null) breps.Add(extr.ToBrep(true));
                }
            }

            // Y-facing windows
            for (int j = 0; j < bayCountY; j++)
            {
                if (!winY[j]) continue;
                double t = bayCountY > 1 ? j / (double)(bayCountY - 1) : 0;
                var ctr = new Point3d(0, off + t * (lengthVal - 2 * off), 0.85);
                var pts = new[] {
                    ctr - Vector3d.YAxis * (wY[j]/2),
                    ctr + Vector3d.YAxis * (wY[j]/2),
                    ctr + Vector3d.YAxis * (wY[j]/2) + Vector3d.ZAxis * hY[j],
                    ctr - Vector3d.YAxis * (wY[j]/2) + Vector3d.ZAxis * hY[j]
                };
                var curves = new[] {
                    new Line(pts[0], pts[1]).ToNurbsCurve(),
                    new Line(pts[1], pts[2]).ToNurbsCurve(),
                    new Line(pts[2], pts[3]).ToNurbsCurve(),
                    new Line(pts[3], pts[0]).ToNurbsCurve()
                };
                var joined = Curve.JoinCurves(curves, tol);
                if (joined?.Length > 0)
                {
                    var prof = joined[0];
                    var extr = Extrusion.Create(prof, widthVal, true);
                    if (extr != null) breps.Add(extr.ToBrep(true));
                }
            }
        }

        // ---- FINAL UNION ----
        try
        {
            subtractAdd = Brep.CreateBooleanUnion(breps, tol);
        }
        catch
        {
            subtractAdd = breps.ToArray();
        }

        // ---- TRANSLATE UNIONED GEOMETRY UP BY floorHeight + floorThickness ----
        double dz = floorHeight + floorThickness;
        var xform = Transform.Translation(0, 0, dz);
        if (subtractAdd is Brep[] arr)
        {
            foreach (var b in arr)
                b.Transform(xform);

            subtractAdd = arr;
        }
    }

    /// <summary>
    /// Builds one column at basePt with:
    /// top-down: square cap (0.025H), circular cap (0.025H),
    /// shaft (0.90H), circular base (0.025H), square base (0.025H).
    /// </summary>
    private void AddColumnAt(
        List<Brep> breps,
        Point3d basePt,
        double r,
        double height)
    {
        double sqBaseH   = 0.025 * height;
        double circBaseH = 0.025 * height;
        double shaftH    = 0.90  * height;
        double circCapH  = 0.025 * height;
        double sqCapH    = 0.025 * height;

        // --- Square extrusion cap (top) ---
        var capSqPlane = new Plane(
            basePt + Vector3d.ZAxis * (sqBaseH + circBaseH + shaftH + circCapH),
            Vector3d.ZAxis
        );
        var capSqBox = new Box(
            capSqPlane,
            new Interval(-r, r),
            new Interval(-r, r),
            new Interval(0, sqCapH)
        );
        breps.Add(Brep.CreateFromBox(capSqBox));

        // --- Circular extrusion cap ---
        breps.Add(
            new Cylinder(
                new Circle(
                    new Plane(
                        basePt + Vector3d.ZAxis * (sqBaseH + circBaseH + shaftH),
                        Vector3d.ZAxis
                    ),
                    r
                ),
                circCapH
            ).ToBrep(true, true)
        );

        // --- Shaft ---
        breps.Add(
            new Cylinder(
                new Circle(
                    new Plane(
                        basePt + Vector3d.ZAxis * (sqBaseH + circBaseH),
                        Vector3d.ZAxis
                    ),
                    r * 0.8
                ),
                shaftH
            ).ToBrep(true, true)
        );

        // --- Circular extrusion base ---
        breps.Add(
            new Cylinder(
                new Circle(
                    new Plane(
                        basePt + Vector3d.ZAxis * sqBaseH,
                        Vector3d.ZAxis
                    ),
                    r
                ),
                circBaseH
            ).ToBrep(true, true)
        );

        // --- Square extrusion base (bottom) ---
        var baseSqPlane = new Plane(basePt, Vector3d.ZAxis);
        var baseSqBox   = new Box(
            baseSqPlane,
            new Interval(-r, r),
            new Interval(-r, r),
            new Interval(0, sqBaseH)
        );
        breps.Add(Brep.CreateFromBox(baseSqBox));
    }

    /// <summary>
    /// Helper: convert int or double input to double.
    /// </summary>
    private double ToDouble(object o)
    {
        if (o is double d) return d;
        if (o is int i)    return i;
        return Convert.ToDouble(o);
    }
}
# ---------- end floor2subtractadd ----------
correctorientation_2 = CSharpScript(extrudedShape=floor2envelope.floorEnvelope)  # -> out, correctedShape; same code as correctorientation
floor2generation = CSharpScript(floorEnvelope=correctorientation_2.correctedShape, subtractAdd=floor2subtractadd.subtractAdd, floorType=floor2type)  # -> out, floorWall; same code as floor1generation
union = CSharpScript(x=floor1generation.floorWall, y=ceiling1generation.ceiling)  # -> out, a; inputs x: list
# ---------- union: C# ----------
// Grasshopper Script Instance
#region Usings
using System;
using System.Linq;
using System.Collections.Generic;
using Rhino;
using Rhino.Geometry;
using Grasshopper.Kernel;
#endregion

public class Script_Instance : GH_ScriptInstance
{
    private void RunScript(List<object> x, object y, ref object a)
    {
        var Y   = y as Brep;
        double tol = RhinoDoc.ActiveDoc.ModelAbsoluteTolerance;

        // union each x-item with Y, then union all results into one Brep
        var pairwise = x
            .SelectMany(o => Brep.CreateBooleanUnion(new[]{ o as Brep, Y }, tol))
            .ToList();

        var all = Brep.CreateBooleanUnion(pairwise, tol);
        a = (all != null && all.Length > 0) ? all[0] : null;
    }
}
# ---------- end union ----------
checkorientation = CSharpScript()  # -> out, report
# ---------- checkorientation: C# ----------
// Grasshopper Script Instance
#region Usings
using System;
using System.Linq;
using Rhino.Geometry;
using Grasshopper.Kernel.Types;
#endregion

public class Script_Instance : GH_ScriptInstance
{
    private void RunScript(object brepInput, ref object report)
    {
        var brep = (brepInput as GH_Brep)?.Value ?? brepInput as Brep;
        if (brep == null)
        {
            report = "Invalid input - provide a Brep";
            return;
        }

        string orientationReport = "";
        int incorrectFaces = 0;
        double tol = RhinoDocument.ModelAbsoluteTolerance;

        foreach (var face in brep.Faces)
        {
            var amp = AreaMassProperties.Compute(face);
            if (amp == null) continue;

            var center = amp.Centroid;
            var normal = face.NormalAt(face.Domain(0).Mid, face.Domain(1).Mid);
            normal.Unitize();

            // Test point slightly offset along normal
            var testPoint = center + normal * 0.1;
            bool isInside = brep.IsPointInside(testPoint, tol, false);

            if (isInside)
            {
                incorrectFaces++;
                orientationReport += $"Face {face.FaceIndex}: Normal points INTO solid (incorrect)\n";
            }
            else
            {
                orientationReport += $"Face {face.FaceIndex}: Normal points OUT (correct)\n";
            }
        }

        report = $"ORIENTATION REPORT:\n" +
                 $"Total faces: {brep.Faces.Count}\n" +
                 $"Incorrect faces: {incorrectFaces}\n\n" +
                 orientationReport;
    }
}
# ---------- end checkorientation ----------
